# Grasshopper definition GrasshopperFile.gh (Grasshopper 1.0.7)

# Set to cardboard thickness -->
panel = Panel("Slot depth -->")
number_slider = Slider(12, range=0..50)
number_slider_2 = Slider(2.4, range=0..5)
number_slider_3 = Slider(3, range=0..5)
subtraction = Subtraction(A=number_slider, B=number_slider_3)
division = Division(A=number_slider_2, B=-2)
vector_xyz = VectorXYZ(XComponent=0, YComponent=number_slider, ZComponent=0)  # -> Vector, Length
rectangle = Rectangle(Plane=PlaneXY(0, 0, 0), XSize=number_slider_2, YSize=number_slider_3, Radius=0)  # -> Rectangle, Length
panel_2 = Panel("Slots")
vector_xyz_2 = VectorXYZ(XComponent=division, YComponent=subtraction, ZComponent=0)  # -> Vector, Length
panel_3 = Panel("Big circle -->")
circle = Circle(Plane=PlaneXY(0, 0, 0), Radius=Slider(4.6, range=0..50))
move = Move(Geometry=circle, Motion=vector_xyz.Vector)  # -> Geometry, Transform
circle_2 = Circle(Plane=PlaneXY(0, 0, 0), Radius=number_slider)
move_2 = Move(Geometry=rectangle.Rectangle, Motion=vector_xyz_2.Vector)  # -> Geometry, Transform
panel_4 = Panel("<-- Smaller circles")
polar_array = PolarArray(Geometry=move.Geometry, Plane=PlaneXY(0, 0, 0), Count=Slider(4, range=0..5), Angle=6.283185307)  # -> Geometry, Transform
polar_array_2 = PolarArray(Geometry=move_2.Geometry, Plane=PlaneXY(0, 0, 0), Count=Slider(4, range=0..5), Angle=6.283185307)  # -> Geometry, Transform
region_difference = RegionDifference(CurvesA=circle_2, CurvesB=polar_array_2.Geometry)
rotate = Rotate(Geometry=polar_array.Geometry, Angle=Slider(172, range=0..360), Plane=PlaneXY(0, 0, 0))  # -> Geometry, Transform
panel_5 = Panel("<-- Bake circular piece")
# <-- Bake piece with cut outs
region_difference_2 = RegionDifference(CurvesA=region_difference, CurvesB=rotate.Geometry)
